# Grasshopper definition table_model.gh (Grasshopper 0.9.76)
# plug-ins: Python Interpreter

gap = Slider(3, range=0..10)
X = UnitX(Factor=expr("-x", Slider(734, range=0..1000)))
glass_t = Slider(25, range=0..100)
size = Slider(1500, range=0..10000)
height = Slider(850, range=0..1000)
architect = Curve([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])
back_off = Move(Geometry=architect, Motion=X)  # -> Geometry, Transform
rectangle = Rectangle(Plane=PlaneXY(0, 0, 0), XSize=size, YSize=size, Radius=0)  # -> Rectangle, Length
Z = UnitZ(Factor=height)
Z_2 = UnitZ(Factor=glass_t)
python = PythonScript(rectangle=rectangle.Rectangle, height=height, glass_thickness=glass_t, gap=gap, bottom_gap=Slider(15, range=0..100))  # -> out, walls
# ---------- python: Python ----------
import rhinoscriptsyntax as rs

delta_height = height - glass_thickness - gap

walls = rs.ExtrudeCurveStraight(rectangle,[0, 0, bottom_gap],[0, 0, delta_height])

rs.MoveObject(walls, [0, 0, bottom_gap])
# ---------- end python ----------
python_2 = PythonScript(height=height, thickness=glass_t)  # -> out, up
# ---------- python_2: Python ----------
up = height - thickness
# ---------- end python_2 ----------
extr = Extrude(Base=rectangle.Rectangle, Direction=Z_2)
cap = CapHoles(Brep=extr)
bbox = Extrude(Base=rectangle.Rectangle, Direction=Z)
Z_3 = UnitZ(Factor=python_2.up)
move = Move(Geometry=cap, Motion=Z_3)  # -> Geometry, Transform
python_3 = PythonScript()  # -> out, a
# ---------- python_3: Python ----------
print "hello"
# ---------- end python_3 ----------
polygon = Polygon(Plane=PlaneXY(0, 0, 0), Radius=3, Segments=6, FilletRadius=0)  # -> Polygon, Length
